# Grasshopper definition Paperhopper_2_PLAY_TEMPLATE.gh (Grasshopper 1.0.7)
# plug-ins: Human, gHowl, Telepathy

# Paperhopper_2_PLAY_TEMPLATE
# PaperHopper
# github.com/dantaeyoung/paperhopper
# -- CALIBRATION:
# 
# You must run this file after calibration!
# 
# If you haven't calibrated, close this file, then open
# 'Paperhopper_1_CALIBRATION.gh'.
# 
# If you have calibrated: Great! Save this file as a new file, then start playing.
# 
# -- PLUGINS:
# 
# This file requires several crucial plugins:
# - Human
# - gHowl
# - Lunchbox
# - Telepathy
# - Bengesht
# If you see errors, then load the plugins into Grasshopper, then close without saving and reopen this file.
# The plugins are conveniently collected in the gh_plugins folder.
# Dan Taeyoung / @dantaeyoung
# Receive and calibrate data from Reactivision based on `calibration.xml`
# If this doesn't work, follow these instructions:
listentoreactivision = BooleanToggle(True)
update_calibration_data = Button()
filter = StreamFilter(Gate=listentoreactivision, Stream1="3333")
udp = UDPReceiver(Port=filter, Pattern="999")  # -> Info, Data
gs_loadcalibrationdata = GSLoadCalibrationData(update=update_calibration_data)  # -> calibrationmmv, calibrationadjustment, playspacerectangle
tag_id = Panel("2")
turn_on_green_detection_circles = BooleanToggle(True)
optional_resetmarkerlist = Button()
troubleshoot = Troubleshoot(T=udp.Info)  # -> message_2, screenwarning_2, screenmessage_2
show_playspace_rectangle = BooleanToggle(True)
texttoscreen = RenderTextToScreen(
    Text=troubleshoot.screenmessage_2,
    Location=Point(84.2174437, 130.7142421, 0),
    Size=35,
    Color=RGB(209, 106, 54),
    m_scWithvp=False)
playspacerectangle = Geometry(gs_loadcalibrationdata.playspacerectangle)
# v0.2
# SETUP
panel = Panel(troubleshoot.message_2)
calibrationreactivision = CalibrationReactivision(
    reset=optional_resetmarkerlist,
    data=udp.Data,
    mmv=gs_loadcalibrationdata.calibrationmmv,
    calibrationadjustment=gs_loadcalibrationdata.calibrationadjustment)  # -> rawplanes_2, rawanglesfrom0to1_2, calibratedids_2, calibratedanglesfrom0to1_2, calibratedplanes, timestamp
enable_testing_data = BooleanToggle(True)
playspacerectangle_2 = RemoteSender(playspacerectangle)
playspacerectangle_3 = RemoteReceiver(playspacerectangle_2)
filter_2 = StreamFilter(Gate=show_playspace_rectangle, Stream1=playspacerectangle_3)
custom_preview_lineweights = CustomPreviewLineweights(Geometry=filter_2, Shader=ColourSwatch(SwatchColor=RGB(148, 148, 148)), Thickness=Slider(2, range=0..10), Absolute=False)
# PLAY
# Use this component to find tags based on tag ID!
panel_2 = Panel("8")

turn_on_debug = BooleanToggle(False)
md_slider = MDSlider(
    SliderMode=0,
    slider_value=Point(0.9360868078, 0.6700220353, 0.5),
    x_domain=Domain(-30, 30),
    y_domain=Domain(-30, 30),
    z_domain=Domain(0, 1))
projectionscale_rhinooverirl = RemoteReceiver()
number_slider = Slider(55, range=0..100)
multiplication = Multiplication(A=projectionscale_rhinooverirl, B=Slider(0.7, range=0..4))

turn_on_blobs = BooleanToggle(False)

testtaglocation = MDSlider(
    SliderMode=0,
    slider_value=Point(0.5612919505, 0.5982844655, 0.5),
    x_domain=Domain(0, 1),
    y_domain=Domain(0, 1),
    z_domain=Domain(0, 1))
test_tag_exists = BooleanToggle(False)
tag_id_2 = Panel("7")
angle = ControlKnob(Decimals=2, Limit=True, Maximum=1, Minimum=0, Range=1, Value=0.73)
playspacerectangle_4 = RemoteReceiver(playspacerectangle_2)
createtesttag = CreateTestTag(playspacerectangle=playspacerectangle_4, testtagid=tag_id_2, coord=testtaglocation, anglefrom0to1=angle)

filter_3 = StreamFilter(Gate=test_tag_exists, Stream1=createtesttag)

testtagdata = RemoteSender(filter_3)

# ----
# This group simulates a testtag that you can control in GH.
# You can copy-paste this and edit the 'Tag ID' form to simulate another tag.
# If both test data and real reactivision data exists, test data will override real data!
testtaglocation_2 = MDSlider(
    SliderMode=0,
    slider_value=Point(0.5612919505, 0.5982844655, 0.5),
    x_domain=Domain(0, 1),
    y_domain=Domain(0, 1),
    z_domain=Domain(0, 1))
# TESTING
# For testing markers without Reactivision
test_tag_exists_2 = BooleanToggle(False)
angle_2 = ControlKnob(Decimals=2, Limit=True, Maximum=1, Minimum=0, Range=1, Value=0.73)
playspacerectangle_5 = RemoteReceiver(playspacerectangle_2)
createtesttag_2 = CreateTestTag(playspacerectangle=playspacerectangle_5, testtagid=tag_id, coord=testtaglocation_2, anglefrom0to1=angle_2)

filter_4 = StreamFilter(Gate=test_tag_exists_2, Stream1=createtesttag_2)

testtagdata_2 = RemoteSender(filter_4)

testtagdata_3 = RemoteReceiver([testtagdata_2, testtagdata])
incorporatetestdata = IncorporateTestData(
    enable_testing_data=enable_testing_data,
    testtagdata=testtagdata_3,
    calibratedids=calibrationreactivision.calibratedids_2,
    calibratedanglesfrom0to1=calibrationreactivision.calibratedanglesfrom0to1_2,
    calibratedplanes=calibrationreactivision.calibratedplanes,
    calibrationtimestamp=calibrationreactivision.timestamp)  # -> calibratedids_5, calibratedanglesfrom0to1_5, calibratedplanes_5, calibrationtimestamp_5
calibratedplanes = RemoteSender(incorporatetestdata.calibratedplanes_5)

calibratedplanes_2 = RemoteReceiver(calibratedplanes)
stream_filter = StreamFilter(Gate=turn_on_blobs, Stream1=calibratedplanes_2)
delaunay_edges = DelaunayEdges(Points=flatten(stream_filter), Plane=PlaneXY(0, 0, 0))  # -> Connectivity, Edges
metaball_t = MetaBallT(Points=flatten(stream_filter), Plane=PlaneXY(0, 0, 0), Threshold=Slider(0.002, range=0..0.003))
length = Length(Curve=metaball_t)
# DEBUG
trim_with_regions = TrimWithRegions(Curve=delaunay_edges.Edges, Regions=metaball_t)  # -> Inside, Outside
geometry = Geometry(trim_with_regions.Outside)
gradient = Gradient(
    LowerLimit=0,
    UpperLimit=Slider(1867, range=0..100000),
    Parameter=length,
    stops=[0: RGB(243, 57, 0), 0.1: RGB(236, 27, 60), 0.2: RGB(210, 0, 118), 0.3: RGB(103, 0, 120), 0.4: RGB(39, 72, 161), 0.5: RGB(1, 192, 229), 0.6: RGB(18, 178, 90), 0.7: RGB(79, 186, 8), 0.8: RGB(220, 237, 32), 0.9: RGB(247, 159, 20), 1: RGB(243, 57, 0)])
custom_preview_lineweights_2 = CustomPreviewLineweights(
    Geometry=geometry,
    Shader=ColourSwatch(SwatchColor=RGB(189, 111, 111)),
    Thickness=Slider(10, range=0..10),
    Absolute=False)
custom_preview_lineweights_3 = CustomPreviewLineweights(Geometry=metaball_t, Shader=gradient, Thickness=Slider(10, range=0..10), Absolute=False)

calibratedplanes_3 = RemoteReceiver(calibratedplanes)
filter_5 = StreamFilter(Gate=turn_on_green_detection_circles, Stream1=calibratedplanes_3)
circle = Circle(Plane=filter_5, Radius=Slider(10, range=0..100))
custom_preview = CustomPreview(Geometry=circle, Material=ColourSwatch(SwatchColor=RGB(34, 97, 7)))
calibratedids = RemoteSender(incorporatetestdata.calibratedids_5)
calibratedanglesfrom0to1 = RemoteSender(incorporatetestdata.calibratedanglesfrom0to1_5)
calibratedanglesfrom0to1_2 = RemoteReceiver(calibratedanglesfrom0to1)
multiplication_2 = Multiplication(A=calibratedanglesfrom0to1_2, B=Slider(360, range=0..1000))

calibratedplanes_4 = RemoteReceiver(calibratedplanes)
stream_filter_2 = StreamFilter(Gate=turn_on_debug, Stream1=calibratedplanes_4)
deconstruct_plane = DeconstructPlane(Plane=stream_filter_2)  # -> Origin, XAxis, YAxis, ZAxis
calibratedids_2 = RemoteReceiver(calibratedids)
move = Move(Geometry=deconstruct_plane.Origin, Motion=md_slider)  # -> Geometry, Transform
deconstruct = Deconstruct(Point=deconstruct_plane.Origin)  # -> XComponent, YComponent, ZComponent
line_sdl = LineSDL(Start=deconstruct_plane.Origin, Direction=deconstruct_plane.YAxis, Length=number_slider)
line_sdl_2 = LineSDL(Start=deconstruct_plane.Origin, Direction=deconstruct_plane.XAxis, Length=number_slider)
concatenate = Concatenate(
    FragmentH="ID: ",
    FragmentG=calibratedids_2,
    FragmentF="x: ",
    FragmentA=deconstruct.XComponent,
    FragmentB=", y: ",
    FragmentC=deconstruct.YComponent,
    FragmentD="rot: ",
    FragmentE=multiplication_2)
gradient_2 = Gradient(
    LowerLimit="0",
    UpperLimit="360",
    Parameter=multiplication_2,
    stops=[0: RGB(243, 57, 0), 0.1: RGB(236, 27, 60), 0.2: RGB(210, 0, 118), 0.3: RGB(103, 0, 120), 0.4: RGB(39, 72, 161), 0.5: RGB(1, 192, 229), 0.6: RGB(18, 178, 90), 0.7: RGB(79, 186, 8), 0.8: RGB(220, 237, 32), 0.9: RGB(247, 159, 20), 1: RGB(243, 57, 0)])
geometry_2 = Geometry([line_sdl_2, line_sdl])
text_tag_3d = TextTag3D(Location=move.Geometry, Text=concatenate, Size=Slider(6, range=0..100), Colour=gradient_2, Justification=7)
# Undo / Redo
# DRWG
custom_preview_lineweights_4 = CustomPreviewLineweights(
    Geometry=geometry_2,
    Shader={diffuse=RGB(255, 105, 180), emission=RGB(76, 32, 54), shine=0.5, specular=RGB(255, 255, 255), transparency=0},
    Thickness=Slider(6, range=0..10),
    Absolute=False)

calibrationtimestamp = RemoteSender(incorporatetestdata.calibrationtimestamp_5)
calibratedanglesfrom0to1_3 = RemoteReceiver(calibratedanglesfrom0to1)
calibratedplanes_5 = RemoteReceiver(calibratedplanes)
calibratedids_3 = RemoteReceiver(calibratedids)
# Find tags based on tag ID
ph_find_tags_v5 = PHFindTagsV5(
    tag_id=panel_2,
    calibratedids=calibratedids_3,
    calibratedplanes=calibratedplanes_5,
    calibratedanglesfrom0to1=calibratedanglesfrom0to1_3)  # -> tag_id_exists_2, calibrated_planes_2, anglefrom0to1_2
panel_3 = Panel(ph_find_tags_v5.calibrated_planes_2)
panel_4 = Panel(ph_find_tags_v5.tag_id_exists_2)
panel_5 = Panel(ph_find_tags_v5.anglefrom0to1_2)

# ==== cluster CalibrationReactivision
data = ClusterInput()
reactivision_osc_to_planes = ReactivisionOscToPlanes(data=data)  # -> id_2, pln_2, angle_2
planes = Plane(reactivision_osc_to_planes.pln_2)
angles = Number(reactivision_osc_to_planes.angle_2)
ids = Number(reactivision_osc_to_planes.id_2)
reset = ClusterInput()
getallkeysseensofar = GetAllKeysSeenSoFar(reset=reset, ids=ids)  # -> simplify(graft(allkeys))
equals = Equality(FirstNumber=getallkeysseensofar, SecondNumber=ids)  # -> Equality, Inequality
dispatch = Dispatch(List=angles, DispatchPattern=equals.Equality)  # -> graft(ListA), ListB
dispatch_2 = Dispatch(List=planes, DispatchPattern=equals.Equality)  # -> graft(ListA), ListB

calibratedids = Number(simplify(getallkeysseensofar))
rawplanes = Plane(simplify(dispatch_2.ListA))
rawangles = Number(simplify(dispatch.ListA))

calibrationadjustment = ClusterInput()
mmv = ClusterInput()
division = Division(A=rawangles, B="Pi * 2")
rawplanes_2 = ClusterOutput(rawplanes)
calibratedids_2 = ClusterOutput(calibratedids)
rawanglesfrom0to1 = Number(simplify(division))
calibration = Calibration(uncalibratedflatplane=rawplanes, mmv=mmv, T=calibrationadjustment)
python = GhPythonScript(input=data)  # -> out, timestamp; inputs input: tree
# ---------- python: Python ----------
import time
timestamp = int(round(time.time()))
# ---------- end python ----------
rawanglesfrom0to1_2 = ClusterOutput(rawanglesfrom0to1)

# ---- group: MAYBE TODO: add calibration rotation
calibratedanglesfrom0to1 = Number(rawanglesfrom0to1)

# ----
calibratedplanes = ClusterOutput(calibration)
timestamp = ClusterOutput(python.timestamp)
calibratedanglesfrom0to1_2 = ClusterOutput(calibratedanglesfrom0to1)

# ==== cluster GSLoadCalibrationData
optional_filename = ClusterInput()
update = ClusterInput()
readcalibrationfile = ReadCalibrationFile(update=update, _0=optional_filename)
decodecalibrationdata = DecodeCalibrationData(jsondump=readcalibrationfile)  # -> calibrationmmv_2, calibrationadjustment_2, playspacerectangle_2
calibrationmmv = ClusterOutput(decodecalibrationdata.calibrationmmv_2)
calibrationadjustment = ClusterOutput(decodecalibrationdata.calibrationadjustment_2)
playspacerectangle = ClusterOutput(decodecalibrationdata.playspacerectangle_2)

# ==== cluster PHFindTagsV5
calibratedanglesfrom0to1 = ClusterInput()
calibratedplanes = ClusterInput()
calibratedids = ClusterInput()
calibratedplanes_2 = RemoteReceiver(simplify(calibratedplanes))
calibratedids_2 = RemoteReceiver(simplify(calibratedids))
calibratedanglesfrom0to1_2 = Number(simplify(calibratedanglesfrom0to1))
tag_id = ClusterInput()
tag_id_2 = Number(tag_id)
match = MatchTree(Tree=calibratedanglesfrom0to1_2, Guide=calibratedids_2)
match_2 = MatchTree(Tree=calibratedplanes_2, Guide=calibratedids_2)
equality = Equality(FirstNumber=graft(tag_id_2), SecondNumber=simplify(flatten(calibratedids_2)))  # -> Equality, Inequality
tree_statistics = TreeStatistics(Tree=calibratedids_2)  # -> Paths, Length, Count
dispatch = Dispatch(List=tree_statistics.Paths, DispatchPattern=equality.Equality)  # -> ListA, ListB
tree_branch = TreeBranch(Tree=match_2, Path=dispatch.ListA, MaintainPaths=True)
tree_branch_2 = TreeBranch(Tree=match, Path=dispatch.ListA, MaintainPaths=True)
null_item = NullItem(Item=tree_branch_2)  # -> NullFlags, InvalidFlags, Description
gate_not = GateNot(A=null_item.NullFlags)
tag_id_exists = Boolean(gate_not)
calibrated_planes = Plane(tree_branch)
tag_id_exists_2 = ClusterOutput(tag_id_exists)
calibrated_planes_2 = ClusterOutput(calibrated_planes)
anglefrom0to1 = Number(tree_branch_2)
anglefrom0to1_2 = ClusterOutput(anglefrom0to1)

# ==== cluster Troubleshoot
panel = Panel("""ERROR: It looks like you have another Grasshopper definition that's listening to Reactivision! 

1. Close the other definition
2. Delete the ">UDP<" component
3. Hit Ctrl-Z to undo

This should work.

If it still doesn't work, try restarting Rhino.""")
panel_2 = Panel("""WARNING: We are listening for messages but not receiving any. 

Is Reactivision on?""")
panel_3 = Panel("""We are receiving messages.

Looks like everything is working great!""")
panel_4 = Panel("""*Listening for*
*No new message*""")
display_warning_text = BooleanToggle(True)
T = ClusterInput()
display_warning_text_2 = BooleanToggle(False)
tmatch = MatchText(Text=T, Pattern=panel_4, Case=True)
display_warning_text_3 = BooleanToggle(True)
tmatch_2 = MatchText(Text=T, Pattern="*A new message*", Case=True)
tmatch_3 = MatchText(Text=T, Pattern="AddressAlreadyInUse*", Case=True)
ma = MassAddition(Input=tmatch)  # -> Result, PartialResults
filter = StreamFilter(Gate=tmatch_2, Stream1=display_warning_text_2)
filter_2 = StreamFilter(Gate=tmatch_2, Stream1=panel_3)
filter_3 = StreamFilter(Gate=tmatch_3, Stream1=panel)
filter_4 = StreamFilter(Gate=tmatch_3, Stream1=display_warning_text)
bool = Boolean(ma.Result)
filter_5 = StreamFilter(Gate=bool, Stream1=display_warning_text_3)
filter_6 = StreamFilter(Gate=bool, Stream1=panel_2)
concat = Concatenate(FragmentA=filter_3, FragmentB=filter_2, FragmentC=filter_6)
or = GateOr(A=filter_4, B=filter, C=filter_5)
screenwarning = Boolean(or)
message = Text(concat)
filter_7 = StreamFilter(Gate=screenwarning, Stream1=message)
screenmessage = Text(filter_7)
message_2 = ClusterOutput(message)
screenwarning_2 = ClusterOutput(screenwarning)
screenmessage_2 = ClusterOutput(screenmessage)

# ==== cluster IncorporateTestData
testtagdata = ClusterInput()
enable_testing_data = ClusterInput()
calibratedanglesfrom0to1 = ClusterInput()
calibratedplanes = ClusterInput()
calibrationtimestamp = ClusterInput()
calibratedids = ClusterInput()
testtagdata_2 = Data(testtagdata)
enable_testing_data_2 = Boolean(enable_testing_data)
filter = StreamFilter(Gate=enable_testing_data_2, Stream1=testtagdata_2)
calibratedids_2 = RemoteSender(calibratedids)
calibratedplanes_2 = RemoteSender(calibratedplanes)
calibrationtimestamp_2 = RemoteSender(calibrationtimestamp)
calibratedanglesfrom0to1_2 = RemoteSender(calibratedanglesfrom0to1)
partition = PartitionList(List=filter, Size="3")
item = ListItem(List=partition, Index=0, Wrap=True)  # -> Item, Item1, Item2
multiplication = Multiplication(A=item.Item2, B="2 * Pi")
testtagids = RemoteSender(item.Item)
xy = XYPlane(Origin=item.Item1)
testtaganglesfrom0to1 = RemoteSender(item.Item2)
prot = RotatePlane(Plane=xy, Angle=multiplication)
calibratedanglesfrom0to1_3 = RemoteReceiver(calibratedanglesfrom0to1_2)
testtaganglesfrom0to1_2 = RemoteReceiver(testtaganglesfrom0to1)
testtagplanes = RemoteSender(prot)
calibratedplanes_3 = RemoteReceiver(calibratedplanes_2)
testtagplanes_2 = RemoteReceiver(testtagplanes)
calibratedids_3 = RemoteReceiver(calibratedids_2)
testtagids_2 = RemoteReceiver(testtagids)
entwine = Entwine(_0_x=simplify(testtagids_2), _1_x=simplify(calibratedids_3))  # -> simplify(s_1)
entwine_2 = Entwine(_0_x=testtaganglesfrom0to1_2, _1_x=calibratedanglesfrom0to1_3)
entwine_3 = Entwine(_0_x=testtagplanes_2, _1_x=calibratedplanes_3)
data = Data(simplify(entwine))
# Earliest ID takes precedence in creating a set,
# so what gets entwined first is privileged.
datatoset = DataToSet(num=flatten(data))  # -> graft(set_2), i
tstat = TreeStatistics(Tree=data)  # -> Paths, Length, Count
panel = Panel(entwine)
item_2 = ListItem(List=tstat.Paths, Index=datatoset.i, Wrap=True)
branchesused = Data(item_2)
calibrationtimestamp_3 = RemoteReceiver(calibrationtimestamp_2)
python = GhPythonScript(input=flatten(entwine))  # -> out, timestamp; inputs input: tree; same code as python
branch = TreeBranch(Tree=data, Path=branchesused, MaintainPaths=False)
branch_2 = Branch(T=entwine_2, P=branchesused)
branch_3 = Branch(T=entwine_3, P=branchesused)
max = GhPythonScript(a=python.timestamp, b=calibrationtimestamp_3)  # -> out, r; inputs a: Int32, b: Int32
# ---------- max: Python ----------
if a is not None and b is not None:
    r = max(a, b)

if a is None:
    r = b

if b is None:
    r = a
    
print r
# ---------- end max ----------
calibrationtimestamp_4 = Number(max.r)
calibratedplanes_4 = Plane(branch_3)
calibratedanglesfrom0to1_4 = Number(branch_2)
panel_2 = Panel(branch_2)
calibratedids_4 = Number(branch)
calibratedanglesfrom0to1_5 = ClusterOutput(calibratedanglesfrom0to1_4)
calibratedplanes_5 = ClusterOutput(calibratedplanes_4)
calibrationtimestamp_5 = ClusterOutput(calibrationtimestamp_4)
calibratedids_5 = ClusterOutput(calibratedids_4)

# ==== cluster CreateTestTag
playspacerectangle = ClusterInput()
coord = ClusterInput()
playspacerectangle_2 = Geometry(playspacerectangle)
coord_2 = Point(coord)
anglefrom0to1 = ClusterInput()
testtagid = ClusterInput()
evalsrf = EvaluateSurface(Surface=reparameterize(playspacerectangle_2), Point=coord_2)  # -> Point, Normal, UDirection, VDirection, Frame
anglefrom0to1_2 = Number(anglefrom0to1)
testtagid_2 = Number(testtagid)
merge = Merge(Data1=testtagid_2, Data2=evalsrf.Point, Data3=anglefrom0to1_2)
R = ClusterOutput(merge)

# ==== cluster GetAllKeysSeenSoFar
reset = ClusterInput()
ids = ClusterInput()
getallkeysseensofar = GhPythonScript(reset=reset, ids=ids)  # -> out, allkeys; inputs ids: list of Int32
# ---------- getallkeysseensofar: Python ----------
import scriptcontext

if reset or "ids" not in scriptcontext.sticky:
    scriptcontext.sticky["ids"] = {}


for id in ids:
    scriptcontext.sticky["ids"][id] = True
    
allkeys = sorted(scriptcontext.sticky["ids"].keys())
# ---------- end getallkeysseensofar ----------
allkeys = ClusterOutput(getallkeysseensofar.allkeys)

# ==== cluster ReactivisionOscToPlanes
data = ClusterInput()
data_2 = Data(data)
lng = ListLength(List=data_2)
series = Series(Start=0, Step=1, Count=lng)
tmatch = MatchText(Text=data_2, Pattern="set", Case=True)
dispatch = Dispatch(List=series, DispatchPattern=tmatch)  # -> ListA, ListB
item = ListItem(List=data_2, Index=dispatch.ListA, Wrap=True)  # -> Item, Item1, Item2, Item3, Item4, Item5
pt = ConstructPoint(XCoordinate=item.Item3, YCoordinate=item.Item4, ZCoordinate=0)
xy = XYPlane(Origin=pt)
prot = RotatePlane(Plane=xy, Angle=item.Item5)
angle = Number(item.Item5)
pln = Plane(prot)
id = Number(item.Item2)
id_2 = ClusterOutput(id)
pln_2 = ClusterOutput(pln)
angle_2 = ClusterOutput(angle)

# ==== cluster Calibration
uncalibratedflatplane = ClusterInput()
mmv = ClusterInput()
uncalibratedflatplane_2 = Plane(uncalibratedflatplane)
calibrationwithmmv = CalibrationWithMMV(pts=uncalibratedflatplane_2, mmv=mmv)
T = ClusterInput()
move = Move(Geometry=calibrationwithmmv, Motion=T)  # -> Geometry, Transform
pl_origin = PlaneOrigin(Base=uncalibratedflatplane_2, Origin=move.Geometry)
pl = ClusterOutput(pl_origin)

# ==== cluster DecodeCalibrationData
jsondump = ClusterInput()
b64dump = ClusterInput()
deserializedata = DEserializeData(jsondump=jsondump, b64dump=b64dump)  # -> keys, vals
bang = ExplodeTree(Data=deserializedata.vals)  # -> Branch0, Branch1, Branch2
playspacerectanglepts = Geometry(bang.Branch2)
calibrationadjustment = Point(bang.Branch1)
calibrationmmv = Number(bang.Branch0)
polyline = PolyLine(Vertices=playspacerectanglepts, Closed=True)
calibrationmmv_2 = ClusterOutput(calibrationmmv)
calibrationadjustment_2 = ClusterOutput(calibrationadjustment)
playspacerectangle = Geometry(polyline)
playspacerectangle_2 = ClusterOutput(playspacerectangle)

# ==== cluster ReadCalibrationFile
update = ClusterInput()
_0 = ClusterInput()
update_2 = Data(update)
gh_filepath = GHFilepath()  # -> filepath, filedir
combine = CombineData(Input0=_0, Input1="calibration.csv")  # -> Result, Index
writecalibrationfile = GhPythonScript(update=update_2, filedir=gh_filepath.filedir, filename=combine.Result)  # -> out, jsondump
# ---------- writecalibrationfile: Python ----------
import ghpythonlib.treehelpers as th
import json
import os 


filepath = os.path.join(filedir, filename)

print filepath

with open(filepath, "r") as f:
    jsondump = f.read()
# ---------- end writecalibrationfile ----------
jsondump = ClusterOutput(writecalibrationfile.jsondump)
panel = Panel(writecalibrationfile.jsondump)

# ==== cluster DataToSet
num = ClusterInput()
num_2 = Number(flatten(num))
cset = CreateSet(List=flatten(num_2))  # -> Set, Map
sort = SortList(Keys=cset.Set)  # -> Keys, ValuesA
mindex = MemberIndex(Set=flatten(num_2), Member=flatten(sort.Keys))  # -> Index, Count
sort_2 = SortList(Keys=mindex.Index)  # -> Keys, ValuesA
set = Number(sort.Keys)
item = ListItem(List=sort_2.Keys, Index=0, Wrap=True)
set_2 = ClusterOutput(set)
i = ClusterOutput(item)
panel = Panel(item)

# ==== cluster Branch
T = ClusterInput()
P = ClusterInput()
branch = TreeBranch(Tree=T, Path=P, MaintainPaths=False)
B = ClusterOutput(branch)

# ==== cluster Entwine
_0_x = ClusterInput()
_1_x = ClusterInput()
item = ListItem(List=flatten(_1_x), Index=0, Wrap=True)
# Entwine.. except pass through original data if either input is 0
item_2 = ListItem(List=flatten(_0_x), Index=0, Wrap=True)
null = NullItem(Item=item)  # -> NullFlags, InvalidFlags, Description
null_2 = NullItem(Item=item_2)  # -> NullFlags, InvalidFlags, Description
entwine = Entwine(Branch0X=_0_x, Branch1X=simplify(_1_x), FlattenInputs=False)  # -> simplify(Result)
filter = StreamFilter(Gate=null.NullFlags, Stream0=entwine, Stream1=_0_x)
filter_2 = StreamFilter(Gate=null_2.NullFlags, Stream0=filter, Stream1=_1_x)
s_1 = ClusterOutput(filter_2)

# ==== cluster CalibrationWithMMV
mmv = ClusterInput()
pts = ClusterInput()
python = GhPythonScript(pts=pts, MMV=mmv)  # -> out, xs, ys, respt; inputs pts: list of Point3d, MMV: list
# ---------- python: Python ----------
from itertools import product

 
 
def multiply(matr_a, matr_b):
    """Return product of an MxP matrix A with an PxN matrix B."""
    cols, rows = len(matr_b[0]), len(matr_b)
    resRows = xrange(len(matr_a))
    rMatrix = [[0] * cols for _ in resRows]
    for idx in resRows:
        for j, k in product(xrange(cols), xrange(rows)):
            rMatrix[idx][j] += matr_a[idx][k] * matr_b[k][j]
    return rMatrix


xs = []
ys = []
for pt in pts:
    d = [[pt.X, pt.Y, 1]]
    MM = [[MMV[0], MMV[1], MMV[2]], [MMV[3], MMV[4], MMV[5]], [MMV[6], MMV[7], MMV[8]]]
    res = multiply(d, MM)[0]
    x = res[0] / res[2]
    y = res[1] / res[2]
    
    xs.append(x)
    ys.append(y)
    respt = (x, y, 0)
# ---------- end python ----------
pt = ConstructPoint(XCoordinate=python.xs, YCoordinate=python.ys, ZCoordinate=0)
topoint = ClusterOutput(pt)

# ==== cluster DEserializeData
jsondump = ClusterInput()
b64dump = ClusterInput()
or = ClusterInput()
or_2 = Data(or)
python = GhPythonScript(jsondump=jsondump, b64dump=b64dump)  # -> out, keys, vals
# ---------- python: Python ----------
import ghpythonlib.treehelpers as th
import json
import base64


thisjsondump = jsondump
if(b64dump):
    thisjsondump = base64.b64decode(b64dump)

d = json.loads(thisjsondump)
keys = th.list_to_tree(d["keys"])
vals = th.list_to_tree(d["vals"])
# ---------- end python ----------
vals = ClusterOutput(python.vals)
keys = ClusterOutput(python.keys)

# ==== cluster GHFilepath
get_gh_filepath = GetGHFilepath()  # -> filepath, filedir
filedir = ClusterOutput(get_gh_filepath.filedir)
panel = Panel(get_gh_filepath.filepath)
filepath = ClusterOutput(get_gh_filepath.filepath)

# ==== cluster GetGHFilepath
get_gh_filepath = GhPythonScript()  # -> out, filepath, filedir
# ---------- get_gh_filepath: Python ----------
import os


thisdoc = ghenv.Component.OnPingDocument()

while thisdoc.FilePath is None:
    #we are inside a cluster
    thisdoc = thisdoc.Owner.OwnerDocument()

filepath = thisdoc.FilePath
filedir = os.path.dirname(filepath)
# ---------- end get_gh_filepath ----------
filedir = ClusterOutput(get_gh_filepath.filedir)
filepath = ClusterOutput(get_gh_filepath.filepath)
