# Grasshopper definition Paperhopper_CameraOnly_TEMPLATE.gh (Grasshopper 1.0.7)
# plug-ins: gHowl, LunchBox, Telepathy

# 1. Use the 'Camera' app in Windows to preview your camera and to make sure it works!
# 2. Turn on Reactivision.exe. Test if it works with a marker.
# Some quick shortcuts:
# o: brings up the camera option menu
# F1: toggles fullscreen
# s: Displays the source image (what the camera sees)
# t: Displays the target image (the processed image)
# h: Displays help text
# 3. See if this works. If not, follow these instructions:
listentoreactivision = BooleanToggle(True)
# 4. If this works, then:
panel = Panel("3333")
filter = StreamFilter(Gate=listentoreactivision, Stream1=panel)
udp = UDPReceiver(Port=filter, Pattern="999")  # -> Info, Data
# PaperHopper
# github.com/dantaeyoung/paperhopper
# Dan Taeyoung / @dantaeyoung
# SETUP / CALIBRATION
troubleshoot = Troubleshoot(T=udp.Info)
panel_2 = Panel(troubleshoot)
calibrationreactivision = CalibrationReactivision(reset=Button(), data=udp.Data)  # -> rawplanes_2, rawanglesfrom0to1_2, calibratedids_2, calibratedplanes, calibratedangles, timestamp
calibratedplanes = RemoteSender(calibrationreactivision.calibratedplanes)
calibrationtimestamp = RemoteSender(calibrationreactivision.timestamp)
calibratedangles = RemoteSender(calibrationreactivision.calibratedangles)
calibratedids = RemoteSender(calibrationreactivision.calibratedids_2)
rawanglesfrom0to1 = RemoteSender(calibrationreactivision.rawanglesfrom0to1_2)
rawplanes = RemoteSender(calibrationreactivision.rawplanes_2)
# 5. Use the below component to get rotation and true/false value by ID.
# You can also do things like trigger events or Rhino commands based on the existence of tags.
rawanglesfrom0to1_2 = RemoteReceiver(rawanglesfrom0to1)
# You can raed more about macros and scripting at:
# 
# https://docs.mcneel.com/rhino/5/help/en-us/information/rhinoscripting.htm
# 
# and
# 
# https://wiki.mcneel.com/rhino/basicmacros
rawanglesfrom0to1_3 = RemoteReceiver(rawanglesfrom0to1)
calibratedplanes_2 = RemoteReceiver(calibratedplanes)
calibratedplanes_3 = RemoteReceiver(calibratedplanes)
calibratedids_2 = RemoteReceiver(calibratedids)
# This file requires several crucial plugins:
# - Human
# - gHowl
# - Lunchbox
# - Telepathy
# - Bengesht
# If you see errors, then load the plugins into Grasshopper, then close without saving and reopen this file. The plugins are conveniently collected in the gh_plugins folder.
# PLAY
panel_3 = Panel("0")
calibratedids_3 = RemoteReceiver(calibratedids)
# If the tag with ID 0 is visible.. save our Rhino document!
panel_4 = Panel("0")
# Find tags based on tag ID
ph_find_tags_v4 = PHFindTagsV4(
    tag_id=panel_3,
    calibratedids=calibratedids_2,
    calibratedplanes=calibratedplanes_2,
    rawanglesfrom0to1=rawanglesfrom0to1_2)  # -> tag_id_exists_2, calibrated_planes_2, anglefrom0to1_2
ph_find_tags_v4_2 = PHFindTagsV4(
    tag_id=panel_4,
    calibratedids=calibratedids_3,
    calibratedplanes=calibratedplanes_3,
    rawanglesfrom0to1=rawanglesfrom0to1_3)  # -> tag_id_exists_2, calibrated_planes_2, anglefrom0to1_2
panel_5 = Panel(ph_find_tags_v4.calibrated_planes_2)
panel_6 = Panel(ph_find_tags_v4.tag_id_exists_2)
panel_7 = Panel(ph_find_tags_v4.anglefrom0to1_2)
panel_8 = Panel(ph_find_tags_v4_2.calibrated_planes_2)
panel_9 = Panel(ph_find_tags_v4_2.anglefrom0to1_2)

rhcom = RhinoCommand(SendCommandToggle=ph_find_tags_v4_2.tag_id_exists_2, CommandString="_Save")

# ==== cluster PHFindTagsV4
calibratedplanes = ClusterInput()
calibratedids = ClusterInput()
rawanglesfrom0to1 = ClusterInput()
tag_id = ClusterInput()
calibratedplanes_2 = RemoteReceiver(calibratedplanes)
calibratedids_2 = RemoteReceiver(calibratedids)
rawanglesfrom0to1_2 = Number(rawanglesfrom0to1)
tag_id_2 = Number(tag_id)
equality = Equality(FirstNumber=graft(tag_id_2), SecondNumber=simplify(flatten(calibratedids_2)))  # -> Equality, Inequality
tree_statistics = TreeStatistics(Tree=calibratedids_2)  # -> Paths, Length, Count
dispatch = Dispatch(List=tree_statistics.Paths, DispatchPattern=equality.Equality)  # -> ListA, ListB
tree_branch = TreeBranch(Tree=calibratedids_2, Path=dispatch.ListA, MaintainPaths=True)
tree_branch_2 = TreeBranch(Tree=calibratedplanes_2, Path=dispatch.ListA, MaintainPaths=True)
tree_branch_3 = TreeBranch(Tree=rawanglesfrom0to1_2, Path=dispatch.ListA, MaintainPaths=True)
null_item = NullItem(Item=tree_branch_3)  # -> NullFlags, InvalidFlags, Description
gate_not = GateNot(A=null_item.NullFlags)
deconstruct_plane = DeconstructPlane(Plane=tree_branch_2)  # -> Origin, XAxis, YAxis, ZAxis
unit_x = UnitX(Factor=1)
tag_id_exists = Boolean(gate_not)
calibrated_planes = Plane(tree_branch_2)
angle = Angle(VectorA=unit_x, VectorB=deconstruct_plane.XAxis)  # -> Angle, Reflex
tag_id_exists_2 = ClusterOutput(tag_id_exists)
division = Division(A=angle.Angle, B="Pi")
calibrated_planes_2 = ClusterOutput(calibrated_planes)
anglefrom0to1 = Number(tree_branch_3)
anglefrom0to1_2 = ClusterOutput(anglefrom0to1)

# ==== cluster CalibrationReactivision
data = ClusterInput()
reactivision_osc_to_planes = ReactivisionOscToPlanes(data=data)  # -> id_2, pln_2, angle_2
planes = Plane(reactivision_osc_to_planes.pln_2)
angles = Number(reactivision_osc_to_planes.angle_2)
ids = Number(reactivision_osc_to_planes.id_2)
reset = ClusterInput()
getallkeysseensofar = GetAllKeysSeenSoFar(reset=reset, ids=ids)  # -> simplify(graft(allkeys))
equals = Equality(FirstNumber=getallkeysseensofar, SecondNumber=ids)  # -> Equality, Inequality
dispatch = Dispatch(List=angles, DispatchPattern=equals.Equality)  # -> graft(ListA), ListB
dispatch_2 = Dispatch(List=planes, DispatchPattern=equals.Equality)  # -> graft(ListA), ListB

calibratedids = Number(simplify(getallkeysseensofar))
rawplanes = Plane(simplify(dispatch_2.ListA))
rawangles = Number(simplify(dispatch.ListA))

calibrationadjustment = ClusterInput()
mmv = ClusterInput()
division = Division(A=rawangles, B="Pi * 2")
rawplanes_2 = ClusterOutput(rawplanes)
calibratedids_2 = ClusterOutput(calibratedids)
rawanglesfrom0to1 = Number(simplify(division))
calibration = Calibration(uncalibratedflatplane=rawplanes, mmv=mmv, T=calibrationadjustment)  # -> pl, A
gettimestamp = GetTimestamp()
python = GhPythonScript(input=data)  # -> out, timestamp; inputs input: tree
# ---------- python: Python ----------
import time
timestamp = int(round(time.time()))
# ---------- end python ----------
rawanglesfrom0to1_2 = ClusterOutput(rawanglesfrom0to1)
calibratedplanes = ClusterOutput(calibration.pl)
calibratedangles = ClusterOutput(calibration.A)
timestamp = ClusterOutput(python.timestamp)

# ==== cluster Troubleshoot
panel = Panel("""It looks like you have another Grasshopper definition that's listening to Reactivision! 

1. Close the other definition
2. Delete the ">UDP<" component
3. Hit Ctrl-Z to undo

This should work!""")
T = ClusterInput()
tmatch = MatchText(Text=T, Pattern="*new message*", Case=True)
tmatch_2 = MatchText(Text=T, Pattern="AddressAlreadyInUse*", Case=True)
filter = StreamFilter(Gate=tmatch, Stream1="Looks like everything is working great!")
filter_2 = StreamFilter(Gate=tmatch_2, Stream1=panel)
concat = Concatenate(FragmentA=filter_2, FragmentB=filter)
message = Text(concat)
message_2 = ClusterOutput(message)

# ==== cluster GetAllKeysSeenSoFar
reset = ClusterInput()
ids = ClusterInput()
getallkeysseensofar = GhPythonScript(reset=reset, ids=ids)  # -> out, allkeys; inputs ids: list of Int32
# ---------- getallkeysseensofar: Python ----------
import scriptcontext

if reset or "ids" not in scriptcontext.sticky:
    scriptcontext.sticky["ids"] = {}


for id in ids:
    scriptcontext.sticky["ids"][id] = True
    
allkeys = sorted(scriptcontext.sticky["ids"].keys())
# ---------- end getallkeysseensofar ----------
allkeys = ClusterOutput(getallkeysseensofar.allkeys)

# ==== cluster ReactivisionOscToPlanes
data = ClusterInput()
data_2 = Data(data)
lng = ListLength(List=data_2)
series = Series(Start=0, Step=1, Count=lng)
tmatch = MatchText(Text=data_2, Pattern="set", Case=True)
dispatch = Dispatch(List=series, DispatchPattern=tmatch)  # -> ListA, ListB
item = ListItem(List=data_2, Index=dispatch.ListA, Wrap=True)  # -> Item, Item1, Item2, Item3, Item4, Item5
pt = ConstructPoint(XCoordinate=item.Item3, YCoordinate=item.Item4, ZCoordinate=0)
xy = XYPlane(Origin=pt)
prot = RotatePlane(Plane=xy, Angle=item.Item5)
angle = Number(item.Item5)
pln = Plane(prot)
id = Number(item.Item2)
id_2 = ClusterOutput(id)
pln_2 = ClusterOutput(pln)
angle_2 = ClusterOutput(angle)

# ==== cluster Calibration
uncalibratedflatplane = ClusterInput()
mmv = ClusterInput()
uncalibratedflatplane_2 = Plane(uncalibratedflatplane)
calibrationwithmmv = CalibrationWithMMV(pts=uncalibratedflatplane_2, mmv=mmv)
T = ClusterInput()
move = Move(Geometry=calibrationwithmmv, Motion=T)  # -> Geometry, Transform
pl_origin = PlaneOrigin(Base=uncalibratedflatplane_2, Origin=move.Geometry)
xy = XYPlane(Origin=Point(0, 0, 0))
deplane = DeconstructPlane(Plane=pl_origin)  # -> Origin, XAxis, YAxis, ZAxis
X = UnitX(Factor=1)
angle = Angle(VectorA=X, VectorB=deplane.XAxis, Plane=xy)  # -> Angle, Reflex
pl = ClusterOutput(pl_origin)
A = ClusterOutput(angle.Angle)

# ==== cluster GetTimestamp: #GetTimestamp
input = ClusterInput()
python = GhPythonScript(input=input)  # -> out, timestamp
# ---------- python: Python ----------
import time
timestamp = int(round(time.time() ))
# ---------- end python ----------
timestamp = ClusterOutput(python.timestamp)

# ==== cluster CalibrationWithMMV
mmv = ClusterInput()
pts = ClusterInput()
python = GhPythonScript(pts=pts, MMV=mmv)  # -> out, xs, ys, respt; inputs pts: list of Point3d, MMV: list
# ---------- python: Python ----------
from itertools import product

 
 
def multiply(matr_a, matr_b):
    """Return product of an MxP matrix A with an PxN matrix B."""
    cols, rows = len(matr_b[0]), len(matr_b)
    resRows = xrange(len(matr_a))
    rMatrix = [[0] * cols for _ in resRows]
    for idx in resRows:
        for j, k in product(xrange(cols), xrange(rows)):
            rMatrix[idx][j] += matr_a[idx][k] * matr_b[k][j]
    return rMatrix


xs = []
ys = []
for pt in pts:
    d = [[pt.X, pt.Y, 1]]
    MM = [[MMV[0], MMV[1], MMV[2]], [MMV[3], MMV[4], MMV[5]], [MMV[6], MMV[7], MMV[8]]]
    res = multiply(d, MM)[0]
    x = res[0] / res[2]
    y = res[1] / res[2]
    
    xs.append(x)
    ys.append(y)
    respt = (x, y, 0)
# ---------- end python ----------
pt = ConstructPoint(XCoordinate=python.xs, YCoordinate=python.ys, ZCoordinate=0)
topoint = ClusterOutput(pt)
